# Grasshopper definition lecture10_1.gh (Grasshopper 0.9.76)

crv = Curve([<curve referenced from the Rhino model> x2])
md_slider = MDSlider(
    slider_value=Point(0.7649136055, 0.3465538955, 0.5),
    SliderMode=0,
    x_domain=Domain(0, 1),
    y_domain=Domain(0, 1),
    z_domain=Domain(0, 1))
loft = Loft(Curves=crv, Options={Adjust=False, Closed=False, LoftEnds=0, LoftSimp=0, LoftType=0, Rebuild=10, Refit=0.01})
srf = Surface(reparameterize(loft))
evalsrf = EvaluateSurface(Surface=srf, Point=md_slider)  # -> Point, Normal, Frame
sph = Sphere(Base=evalsrf.Point, Radius=Slider(5.2, range=0..100))
panel = Panel(sph)
