# Grasshopper definition lecture10_3.gh (Grasshopper 0.9.76)

crv = Curve([<curve referenced from the Rhino model> x2])
md_slider = MDSlider(
    slider_value=Point(0.7649136055, 0.3465538955, 0.5),
    SliderMode=0,
    x_domain=Domain(0, 1),
    y_domain=Domain(0, 1),
    z_domain=Domain(0, 1))
loft = Loft(Curves=crv, Options={Adjust=False, Closed=False, LoftEnds=0, LoftSimp=0, LoftType=0, Rebuild=10, Refit=0.01})
range = Range(Domain=Domain(0, 1), Steps=Slider(10, range=0..10))
srf = Surface(reparameterize(loft))
range_2 = Range(Domain=Domain(0, 1), Steps=Slider(10, range=0..10))
graft = GraftTree(Tree=range_2, IncludeEmptyLists=True, IncludeNullItems=True)
pt = ConstructPoint(XCoordinate=range, YCoordinate=graft, ZCoordinate=0)
evalsrf = EvaluateSurface(Surface=srf, Point=pt)  # -> Point, Normal, Frame
pln = Plane(evalsrf.Frame)
deplane = DeconstructPlane(Plane=pln)  # -> Origin, XAxis, YAxis, ZAxis
amp = Amplitude(Vector=deplane.XAxis, Amplitude=Slider(5, range=0..10))
amp_2 = Amplitude(Vector=deplane.ZAxis, Amplitude=Slider(10, range=0..10))
neg = Negative(Value=amp_2)
move = Move(Geometry=deplane.Origin, Motion=neg)  # -> Geometry, Transform
addition = Addition(A=amp, B=neg)
vdis = VectorDisplay(Anchor=move.Geometry, Vector=amp)
move_2 = Move(Geometry=move.Geometry, Motion=amp)  # -> Geometry, Transform
move_3 = Move(Geometry=deplane.Origin, Motion=addition)  # -> Geometry, Transform
vdis_2 = VectorDisplay(Anchor=deplane.Origin, Vector=neg)
vdis_3 = VectorDisplay(Anchor=deplane.Origin, Vector=addition)
sph = Sphere(Base=move_3.Geometry, Radius=1)
preview = CustomPreview(
    Geometry=sph,
    Shader={ambient=RGB(0, 0, 0), diffuse=RGB(255, 105, 180), emission=RGB(76, 32, 54), shine=0.5, specular=RGB(255, 255, 255), transparency=0})
