# Grasshopper definition lecture10_4.gh (Grasshopper 0.9.76)

crv = Curve([<curve referenced from the Rhino model> x2])
loft = Loft(Curves=crv, Options={Adjust=False, Closed=False, LoftEnds=0, LoftSimp=0, LoftType=0, Rebuild=10, Refit=0.01})
md_slider = MDSlider(
    slider_value=Point(0.2943777689, 0.5409312597, 0.5),
    SliderMode=0,
    x_domain=Domain(0, 1),
    y_domain=Domain(0, 1),
    z_domain=Domain(0, 1))
cir = Circle(Plane=PlaneXY(0, 0, 0), Radius=Slider(2.5, range=0..10))
Z = UnitZ(Factor=Slider(10, range=0..10))
boundary = BoundarySurfaces(Edges=cir)
range = Range(Domain=Domain(0, 1), Steps=Slider(10, range=0..10))
srf = Surface(reparameterize(loft))
range_2 = Range(Domain=Domain(0, 1), Steps=Slider(10, range=0..10))
preview = CustomPreview(Geometry=srf, Shader=ColourSwatch(SwatchColor=RGB(31, 98, 255)))
neg = Negative(Value=Z)
graft = GraftTree(Tree=range_2, IncludeEmptyLists=True, IncludeNullItems=True)
evalsrf = EvaluateSurface(Surface=srf, Point=md_slider)  # -> Point, Normal, Frame
extr = Extrude(Base=boundary, Direction=neg)
pt = ConstructPoint(XCoordinate=range, YCoordinate=graft, ZCoordinate=0)
evalsrf_2 = EvaluateSurface(Surface=srf, Point=pt)  # -> Point, Normal, Frame
dist = Distance(PointA=evalsrf.Point, PointB=evalsrf_2.Point)
pln = Plane(evalsrf_2.Frame)
xy = XYPlane(Origin=Point(0, 0, 0))
orient = Orient(Geometry=extr, Source=xy, Target=pln)  # -> Geometry, Transform
remap = RemapNumbers(Value=dist, Source=Slider(100, range=0..100), Target=Slider(2, range=0..10))  # -> Mapped, Clipped
scale = Scale(Geometry=orient.Geometry, Center=evalsrf_2.Point, Factor=remap.Mapped)  # -> Geometry, Transform
panel = Panel(dist)
preview_2 = CustomPreview(
    Geometry=scale.Geometry,
    Shader={ambient=RGB(0, 0, 0), diffuse=RGB(255, 105, 180), emission=RGB(76, 32, 54), shine=0.5, specular=RGB(255, 255, 255), transparency=0})
