# Grasshopper definition Morph.gh (Grasshopper 0.9.76)

pt = ConstructPoint(XCoordinate=0, YCoordinate=0, ZCoordinate=0)
X = UnitX(Factor=Slider(472, range=0..1000))
circle = CircleCNR(Center=pt, Normal=Vector(0, 0, 1), Radius=Slider(150, range=0..1000))
move = Move(Geometry=circle, Motion=X)  # -> Geometry, Transform
divide = DivideCurve(Curve=move.Geometry, Count=Slider(6, range=0..10), Kinks=False)  # -> Points, Tangents, Parameters
series = Series(Start=0, Step=Slider(30, range=0..100), Count=Slider(10, range=0..10))
pline = PolyLine(Vertices=divide.Points, Closed=True)
number_slider = Slider(10, range=0..10)
Z = UnitZ(Factor=series)
neg = Negative(Value=Slider(0.09, range=0..1))
flip = FlipCurve(Curve=pline)  # -> Curve, Flag
move_2 = Move(Geometry=flip.Curve, Motion=Z)  # -> Geometry, Transform
rad = Radians(Degrees=Slider(7, range=0..10))
series_2 = Series(Start=Slider(1, range=0..1), Step=neg, Count=number_slider)
area = Area(Geometry=move_2.Geometry)  # -> Area, Centroid
series_3 = Series(Start=0, Step=rad, Count=number_slider)
scale = Scale(Geometry=move_2.Geometry, Center=area.Centroid, Factor=series_2)  # -> Geometry, Transform
rotate = Rotate(Geometry=scale.Geometry, Angle=series_3, Plane=area.Centroid)  # -> Geometry, Transform
loft = Loft(Curves=rotate.Geometry, Options={Adjust=False, Closed=False, LoftEnds=0, LoftSimp=0, LoftType=3, Rebuild=10, Refit=0.01})
pt_2 = Point(Point(0, 0, 0))
preview = CustomPreview(
    Geometry=loft,
    Shader={ambient=RGB(0, 0, 0), diffuse=RGB(255, 105, 180), emission=RGB(76, 32, 54), shine=0.5, specular=RGB(255, 255, 255), transparency=0})
debrep = DeconstructBrep(Brep=loft)  # -> Faces, Edges, Vertices
Z_2 = UnitZ(Factor=Slider(20, range=0..100))
debrep_2 = DeconstructBrep(Brep=loft)  # -> graft(Faces), Edges, Vertices
circle_2 = CircleCNR(Center=pt_2, Normal=Vector(0, 0, 1), Radius=Slider(10, range=0..10))
pt_3 = Point(Point(0.5, 0.5, 0))
number_slider_2 = Slider(1, range=0..10)
evalsrf = EvaluateSurface(Surface=reparameterize(debrep.Faces), Point=pt_3)  # -> Point, Normal, Frame
divide_2 = DivideCurve(Curve=circle_2, Count=Slider(4, range=0..10), Kinks=False)  # -> Points, Tangents, Parameters
panel = Panel(debrep_2.Faces)
move_3 = Move(Geometry=pt_2, Motion=Z_2)  # -> Geometry, Transform
pline_2 = PolyLine(Vertices=divide_2.Points, Closed=True)
divide_3 = DivideDomain²(Domain=debrep_2.Faces, UCount=number_slider_2, VCount=number_slider_2)
extr = ExtrudePoint(Base=pline_2, Point=move_3.Geometry)
sbox = SurfaceBox(Surface=debrep_2.Faces, Domain=divide_3, Height=Slider(22, range=0..100))
orient = Orient(Geometry=extr, Source=PlaneXY(0, 0, 0), Target=evalsrf.Frame)  # -> Geometry, Transform
bbox = BoundingBox(Content=extr, Plane=PlaneXY(0, 0, 0))  # -> Box, Box_2
morph = BoxMorph(Geometry=extr, Reference=bbox.Box, Target=sbox)
preview_2 = CustomPreview(
    Geometry=morph,
    Shader={ambient=RGB(0, 0, 0), diffuse=RGB(255, 105, 180), emission=RGB(76, 32, 54), shine=0.5, specular=RGB(255, 255, 255), transparency=0})
