# Grasshopper definition リスト操作の応用.gh (Grasshopper 0.9.76)

pt = ConstructPoint(XCoordinate=0, YCoordinate=0, ZCoordinate=0)
X = UnitX(Factor=Slider(227, range=0..1000))
circle = CircleCNR(Center=pt, Normal=Vector(0, 0, 1), Radius=Slider(150, range=0..1000))
move = Move(Geometry=circle, Motion=X)  # -> Geometry, Transform
divide = DivideCurve(Curve=move.Geometry, Count=Slider(7, range=0..10), Kinks=False)  # -> Points, Tangents, Parameters
series = Series(Start=0, Step=Slider(30, range=0..100), Count=Slider(10, range=0..10))
pline = PolyLine(Vertices=divide.Points, Closed=True)
number_slider = Slider(10, range=0..10)
Z = UnitZ(Factor=series)
neg = Negative(Value=Slider(0.09, range=0..1))
flip = FlipCurve(Curve=pline)  # -> Curve, Flag
move_2 = Move(Geometry=flip.Curve, Motion=Z)  # -> Geometry, Transform
rad = Radians(Degrees=Slider(7, range=0..10))
series_2 = Series(Start=Slider(1, range=0..1), Step=neg, Count=number_slider)
area = Area(Geometry=move_2.Geometry)  # -> Area, Centroid
series_3 = Series(Start=0, Step=rad, Count=number_slider)
scale = Scale(Geometry=move_2.Geometry, Center=area.Centroid, Factor=series_2)  # -> Geometry, Transform
rotate = Rotate(Geometry=scale.Geometry, Angle=series_3, Plane=area.Centroid)  # -> Geometry, Transform
pt_2 = Point(Point(0, 0, 0))
loft = Loft(Curves=rotate.Geometry, Options={Adjust=False, Closed=False, LoftEnds=0, LoftSimp=0, LoftType=3, Rebuild=10, Refit=0.01})
debrep = DeconstructBrep(Brep=loft)  # -> Faces, Edges, Vertices
Z_2 = UnitZ(Factor=Slider(20, range=0..100))
circle_2 = CircleCNR(Center=pt_2, Normal=Vector(0, 0, 1), Radius=Slider(10, range=0..10))
pt_3 = Point(Point(0.5, 0.5, 0))
panel = Panel(debrep.Faces)
evalsrf = EvaluateSurface(Surface=reparameterize(debrep.Faces), Point=pt_3)  # -> Point, Normal, Frame
divide_2 = DivideCurve(Curve=circle_2, Count=Slider(4, range=0..10), Kinks=False)  # -> Points, Tangents, Parameters
move_3 = Move(Geometry=pt_2, Motion=Z_2)  # -> Geometry, Transform
pline_2 = PolyLine(Vertices=divide_2.Points, Closed=True)
preview = CustomPreview(Geometry=debrep.Faces, Shader=ColourSwatch(SwatchColor=RGB(0, 157, 255)))
extr = ExtrudePoint(Base=pline_2, Point=move_3.Geometry)
orient = Orient(Geometry=extr, Source=PlaneXY(0, 0, 0), Target=evalsrf.Frame)  # -> Geometry, Transform
preview_2 = CustomPreview(
    Geometry=extr,
    Shader={ambient=RGB(0, 0, 0), diffuse=RGB(255, 105, 180), emission=RGB(76, 32, 54), shine=0.5, specular=RGB(255, 255, 255), transparency=0})
preview_3 = CustomPreview(
    Geometry=orient.Geometry,
    Shader={ambient=RGB(0, 0, 0), diffuse=RGB(255, 105, 180), emission=RGB(76, 32, 54), shine=0.5, specular=RGB(255, 255, 255), transparency=0})
