# Grasshopper definition Twisted Column.gh (Grasshopper 0.9.76)

cir = Circle(Plane=PlaneXY(0, 0, 0), Radius=Slider(100, range=0..100))
divide = DivideCurve(Curve=reparameterize(cir), Count=Slider(100, range=0..100), Kinks=False)  # -> Points, Tangents, Parameters
pi = Pi(Factor=Slider(14, range=0..20))
multiplication = Multiplication(A=divide.Parameters, B=pi)
sin = Sine(Value=multiplication)
multiplication_2 = Multiplication(A=sin, B=Slider(22.6, range=0..100))
amp = Amplitude(Vector=divide.Points, Amplitude=multiplication_2)
number_slider = Slider(39, range=0..100)
move = Move(Geometry=divide.Points, Motion=amp)  # -> Geometry, Transform
nurbs = NurbsCurve(Vertices=move.Geometry, Degree=3, Periodic=True)  # -> Curve, Length, Domain
series = Series(Start=0, Step=Slider(17.9, range=0..40), Count=number_slider)
series_2 = Series(Start=0, Step=Slider(20.8, range=0..100), Count=number_slider)
series_3 = Series(Start=0, Step=Slider(6, range=0..45), Count=number_slider)
rad = Radians(Degrees=series_2)
rad_2 = Radians(Degrees=series_3)
Z = UnitZ(Factor=series)
move_2 = Move(Geometry=nurbs.Curve, Motion=Z)  # -> Geometry, Transform
sin_2 = Sine(Value=rad)
rotate = Rotate(Geometry=move_2.Geometry, Angle=rad_2, Plane=PlaneXY(0, 0, 0))  # -> Geometry, Transform
multiplication_3 = Multiplication(A=sin_2, B=Slider(0.42, range=0..1))
addition = Addition(A=Slider(1, range=0..1), B=multiplication_3)
scale_nu = ScaleNU(Geometry=rotate.Geometry, Plane=PlaneXY(0, 0, 0), ScaleX=addition, ScaleY=addition, ScaleZ=1)  # -> Geometry, Transform
loft = Loft(
    Curves=scale_nu.Geometry,
    Options={Adjust=False, Closed=False, LoftEnds=0, LoftSimp=0, LoftType=0, Rebuild=10, Refit=0.01})
cap = CapHoles(Brep=loft)
preview = CustomPreview(Geometry=cap, Shader=ColourSwatch(SwatchColor=RGB(255, 87, 87)))
